# Grasshopper definition DefMaster.gh (Grasshopper 0.9.75)
# plug-ins: Python Interpreter, Weaverbird

plug_load_power_density = Slider(0, range=0..1)
lighting_power_density = Slider(1, range=0..1)
minimum_airflow_at_terminal_box = Slider(1, range=0..1)
number_slider = Slider(12, range=0..100)
addition = Addition(A=lighting_power_density, B="1")
addition_2 = Addition(A=minimum_airflow_at_terminal_box, B="1")
addition_3 = Addition(A=plug_load_power_density, B="1")
getconnectedsliders = CSharpScript(x=[plug_load_power_density, lighting_power_density, minimum_airflow_at_terminal_box])  # -> out, A, B; inputs x: tree
# ---------- getconnectedsliders: C# ----------
    List<string> sliderList = new List<string>();
    foreach(GH_DocumentObject obj in GrasshopperDocument.Objects) {
      if(obj is GH_ActiveObject){
        GH_ActiveObject act = obj as GH_ActiveObject;
        Grasshopper.Kernel.Special.GH_NumberSlider slider = obj as Grasshopper.Kernel.Special.GH_NumberSlider;
        if (slider != null){
          if(this.Component.DependsOn(act)){
            sliderList.Add(slider.NickName);
          }
        }
      }
    }
    A = sliderList;
    B = x;
# ---------- end getconnectedsliders ----------
multiplication = Multiplication(A=addition_3, B=number_slider)
multiplication_2 = Multiplication(A=addition, B=number_slider)
multiplication_3 = Multiplication(A=addition_2, B=number_slider)
mbox = MeshBox(
    Base={Plane=PlaneXY(0, 0, 0), X=Domain(-10, 10), Y=Domain(-10, 10), Z=Domain(-10, 10)},
    XCount=multiplication,
    YCount=multiplication_2,
    ZCount=multiplication_3)
box = CenterBox(Base=PlaneXY(0, 0, 0), X=addition_3, Y=addition, Z=addition_2)
volume = Volume(Geometry=box)  # -> Volume, Centroid
demesh = DeconstructMesh(Mesh=mbox)  # -> Vertices, Faces, Colours, Normals
wbframe = WeaverbirdsPictureFrame(MeshPolylines=mbox, Distance=5, InsetType=0)
merge = Merge(Data1=getconnectedsliders.A, Data2="volume")
lng = ListLength(List=demesh.Faces)
merge_2 = Merge(Data1=getconnectedsliders.B, Data2=lng)
update = Button()
mkdict = PythonScript(x=merge, y=merge_2)  # -> out, a, b; inputs x: list, y: list
# ---------- mkdict: Python ----------
import json
dict = {}
for i,j in zip(x,y):
    dict[i] = j
arrDict = [dict]
a = arrDict
b = json.dumps(dict)
# ---------- end mkdict ----------
c_script = CSharpScript(x=update)  # -> out, C, E
# ---------- c_script: C# ----------
    if(GrasshopperDocument.IsFilePathDefined){
      C = GrasshopperDocument.FilePath;

      System.IO.FileInfo info = new System.IO.FileInfo(GrasshopperDocument.FilePath);
      E = info.Name;
    } else {
      C = "Unsaved Document";
    }
# ---------- end c_script ----------
writeresults = WriteResults(T=c_script.E, data=mkdict.b, _0="C:/Data/")

# ==== cluster WriteResults
T = ClusterInput()
rep = ReplaceText(Text=T, Find=".gh", Replace="_results.json", RecursiveReplace=False)
_0 = ClusterInput()
format = Format(Format="{0}/{1}", Culture=127, Data0=_0, Data1=rep)
data = ClusterInput()
writetexttofile = CSharpScript(data=data, y=format)  # -> out, A; inputs data: list of String, y: String
# ---------- writetexttofile: C# ----------
    using (System.IO.StreamWriter file = new System.IO.StreamWriter(y))
    {
      foreach (string line in data)
      {
       
          file.WriteLine(line);
        
      }
    }
# ---------- end writetexttofile ----------
