# Grasshopper definition ReadImgFromJson.gh (Grasshopper 0.9.75)
# plug-ins: Python Interpreter, HDTReference

panel = Panel("C:\Data\DefMaster_results.json")
dir = DirectoryContents(FolderPath="C:\Users\Andheum\Documents\pollinator\pollinate", Filter="*done.receipt", IncludeSubfolders=True)  # -> FilePaths, FileNames
list = ItemSelector(
    dir.FilePaths,
    {"C:\Users\Andheum\Documents\pollinator\pollinate\done.receipt"}, selected="C:\Users\Andheum\Documents\pollinator\pollinate\done.receipt")
file = ReadFile(File=list, PerLineParse=True)
readjson = PythonScript(x=file)  # -> out, a, b
# ---------- readjson: Python ----------
import json
dict = json.loads(x)
keys = []
vals = []
for key in dict:
     keys.append(key)
     vals.append(dict[key])
a = keys
b = vals
# ---------- end readjson ----------
srf = Srf(<srf referenced from the Rhino model>)
fsim = FindSimilarMember(Data="capture", Set=readjson.a)  # -> Hit, Index
item = ListItem(List=readjson.b, Index=fsim.Index, Wrap=True)
c_script = CSharpScript(x=item)  # -> out, A; inputs x: String
# ---------- c_script: C# ----------
    byte[] array = Convert.FromBase64String(x);
    System.ComponentModel.TypeConverter tc = System.ComponentModel.TypeDescriptor.GetConverter(typeof(Bitmap));
    Bitmap bitmap1 = (Bitmap) tc.ConvertFrom(array);
    string saveDir = @"C:\data\imgTest.jpg";
    bitmap1.Save(saveDir);
    A = saveDir;
# ---------- end c_script ----------
previewmat = CustomPreviewMaterials(Geometry=srf, DiffuseColor=RGB(255, 255, 255), DiffuseBitmap=c_script.A)
previewmat_2 = CustomPreviewMaterials(DiffuseColor=RGB(255, 255, 255))
